# Dynamo graph Summer BIM course 1.dyn (Dynamo 0.9.1.4062)

# group: POINTS
number = DoubleInput(0)
number_2 = DoubleInput(0)
integer_slider = IntegerSlider(14, range=1..20 step 1)
number_3 = DoubleInput(250)
sequence = Sequence(start=number_2, amount=integer_slider, step=number_3, lacing=Longest)
number_4 = DoubleInput(0)
byCoordinates = Point.ByCoordinates(x=number, y=sequence, z=number_4)
number_slider = DoubleSlider(330, range=300..600 step 10)
byCoordinates_2 = Point.ByCoordinates(x=number, y=sequence, z=number_slider)
number_slider_2 = DoubleSlider(500, range=400..800 step 10)
number_slider_3 = DoubleSlider(86.8, range=0..200 step 0.1)
add = number_slider + number_slider_3
byCoordinates_3 = Point.ByCoordinates(x=number_slider_2, y=sequence, z=add)

# group: CURVES
byStartPointEndPoint = Line.ByStartPointEndPoint(startPoint=byCoordinates, endPoint=byCoordinates_2)
byStartPointEndPoint_2 = Line.ByStartPointEndPoint(startPoint=byCoordinates_2, endPoint=byCoordinates_3)

# group: MODEL ELEMENTS
byElevation = Level.ByElevation(number_4)
structural_column_types = StructuralColumnTypes("120 x 80RHS")
columnByCurve = StructuralFraming.ColumnByCurve(curve=byStartPointEndPoint, level=byElevation, structuralColumnType=structural_column_types)
structural_framing_types = StructuralFramingTypes("20x40")
beamByCurve = StructuralFraming.BeamByCurve(curve=byStartPointEndPoint_2, level=byElevation, structuralFramingType=structural_framing_types)

# group: EXPORT TO EXCEL
parameters = Element.Parameters(beamByCurve)
file_path = Filename("C:\Users\eschefo\Desktop\LIST BEAM")
string = StringInput("\"beams\";")
number_5 = DoubleInput(4)
number_6 = DoubleInput(0)
string_2 = StringInput("Cut Length")
getParameterValueByName = Element.GetParameterValueByName(element=beamByCurve, parameterName=string_2)
boolean = BoolSelector(false)
writeToFile = Excel.WriteToFile(filePath=file_path, sheetName=string, startRow=number_5, startCol=number_6, data=getParameterValueByName, overWrite=boolean)
string_3 = StringInput("Type")
getParameterValueByName_2 = Element.GetParameterValueByName(element=beamByCurve, parameterName=string_3)
parameters_2 = Element.Parameters(getParameterValueByName_2)
